# Grasshopper definition レンガ230601.gh (Grasshopper 1.0.7)

厚み = Slider(200, range=0..1000)

srf = Surface(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)

recgrid = Rectangular(Plane=PlaneXY(0, 0, 0), SizeX="1", SizeY="1", ExtentX=Slider(20, range=0..100), ExtentY=Slider(30, range=0..100))  # -> Cells, Points
tstat = TreeStatistics(Tree=recgrid.Cells)  # -> Paths, Length, Count
series = Series(Start=0, Step=1, Count=tstat.Count)
series_2 = Series(Start=series, Step=1, Count=tstat.Length)  # -> expr("x-x%2", Series)
cset = CreateSet(List=series_2)  # -> Set, Map
mindex = MemberIndex(Set=series_2, Member=cset.Set)  # -> Index, Count
trim = TrimTree(Tree=mindex.Index, Depth=1)
item = ListItem(List=recgrid.Cells, Index=trim, Wrap=True)
unflatten = UnflattenTree(Tree=item, Guide=mindex.Index)
bbox = BoundingBox(Content=flatten(item), Plane=PlaneXY(0, 0, 0), UnionBox=True)  # -> Box, Box_2
bbox_2 = BoundingBox(Content=unflatten, Plane=PlaneXY(0, 0, 0), UnionBox=True)  # -> Box, Box_2
boxrec = BoxRectangle(Rectangle=bbox_2.Box, Height=厚み)
rec = Rectangle(bbox.Box)
sporph = Sporph(G=boxrec, S0=reparameterize(rec), P0="0,0", S1=reparameterize(srf), P1="0,0", R=False)
