# Grasshopper definition レンガ230602.gh (Grasshopper 1.0.7)

厚み = Slider(200, range=0..1000)

srf = Surface(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)

recgrid = Rectangular(Plane=PlaneXY(0, 0, 0), SizeX="1", SizeY="1", ExtentX=Slider(20, range=0..100), ExtentY=Slider(30, range=0..100))  # -> Cells, Points
tstat = TreeStatistics(Tree=recgrid.Cells)  # -> Paths, Length, Count
series = Series(Start=0, Step=1, Count=tstat.Count)
series_2 = Series(Start=series, Step=1, Count=tstat.Length)  # -> expr("x-x%2", Series)
cset = CreateSet(List=series_2)  # -> Set, Map
mindex = MemberIndex(Set=series_2, Member=cset.Set)  # -> Index, Count
trim = TrimTree(Tree=mindex.Index, Depth=1)
item = ListItem(List=recgrid.Cells, Index=trim, Wrap=True)
unflatten = UnflattenTree(Tree=item, Guide=mindex.Index)
bbox = BoundingBox(Content=flatten(item), Plane=PlaneXY(0, 0, 0), UnionBox=True)  # -> Box, Box_2
bbox_2 = BoundingBox(Content=unflatten, Plane=PlaneXY(0, 0, 0), UnionBox=True)  # -> Box, Box_2
boxrec = BoxRectangle(Rectangle=bbox_2.Box, Height=厚み)
rec = Rectangle(bbox.Box)
sporph = Sporph(G=boxrec, S0=reparameterize(rec), P0="0,0", S1=reparameterize(srf), P1="0,0", R=False)

debrep = DeconstructBrep(Brep=sporph)  # -> Faces, Edges, Vertices
item_2 = ListItem(List=debrep.Faces, Index="3", Wrap=True)  # -> graft(Item)
popgeo = PopulateGeometry(Geometry=item_2, Count="20", Seed=1)
srf_cp = SurfaceClosestPoint(Point=popgeo, Surface=item_2)  # -> Point, UVPoint, Distance
evalsrf = EvaluateSurface(Surface=item_2, Point=srf_cp.UVPoint)  # -> Point, Normal, UDirection, VDirection, Frame
bbox_3 = BoundingBox(Content=sporph, Plane=evalsrf.Frame, UnionBox=True)  # -> Box, Box_2
debox = DeconstructBox(Box=bbox_3.Box)  # -> Plane, X, Y, Z
sort = SortList(Keys=debox.Z, ValuesA=bbox_3.Box)  # -> Keys, ValuesA
item_3 = ListItem(List=sort.ValuesA, Index=0, Wrap=True)
panel = Panel("""0
90
150
180
200
210
240
270
300""")
debox_2 = DeconstructBox(Box=item_3)  # -> Plane, X, Y, Z
consec = ConsecutiveDomains(Numbers=panel, Additive=False)
fdom = FindDomain(Domains=consec, Number=debox_2.Z, Strict=False)  # -> flatten(Index), Neighbour
dedomain = DeconstructDomain(Domain=consec)  # -> Start, End
index = ItemIndex(List=consec, Item=consec)
mindex_2 = MemberIndex(Set=fdom.Index, Member=index)  # -> Index, Count
bnd = Bounds(Numbers=index)
item_4 = ListItem(List=flatten(sporph), Index=mindex_2.Index, Wrap=True)
remap = RemapNumbers(Value=index, Source=bnd, Target=Domain(0, 1))  # -> Mapped, Clipped
format = Format(Format="{0}mm: {1}個", Culture=127, Data0=dedomain.End, Data1=mindex_2.Count)
gradient = Gradient(
    LowerLimit=0,
    UpperLimit=1,
    Parameter=remap.Mapped,
    stops=[0: RGB(234, 38, 0), 0.25: RGB(234, 126, 0), 0.5: RGB(254, 244, 84), 0.75: RGB(173, 203, 249), 1: RGB(75, 107, 169)])
legend = Legend(Colour=gradient, Tags=format, LegendType=1)
preview = CustomPreview(Geometry=item_4, Material=graft(gradient))
