# Grasshopper definition レンガ230605.gh (Grasshopper 1.0.7)
# plug-ins: OpenNest

# ----
# *PackageManagerでOpenNest1.5.1をインストールする
number_slider = Slider(20, range=0..100)
厚み = Slider(200, range=0..1000)

srf = Surface(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)

recgrid = Rectangular(Plane=PlaneXY(0, 0, 0), SizeX="1", SizeY="1", ExtentX=number_slider, ExtentY=Slider(30, range=0..100))  # -> Cells, Points
tstat = TreeStatistics(Tree=recgrid.Cells)  # -> Paths, Length, Count
series = Series(Start=0, Step=1, Count=tstat.Count)
series_2 = Series(Start=series, Step=1, Count=tstat.Length)  # -> expr("x-x%2", Series)
cset = CreateSet(List=series_2)  # -> Set, Map
mindex = MemberIndex(Set=series_2, Member=cset.Set)  # -> Index, Count
trim = TrimTree(Tree=mindex.Index, Depth=1)
item = ListItem(List=recgrid.Cells, Index=trim, Wrap=True)
unflatten = UnflattenTree(Tree=item, Guide=mindex.Index)
bbox = BoundingBox(Content=flatten(item), Plane=PlaneXY(0, 0, 0), UnionBox=True)  # -> Box, Box_2
bbox_2 = BoundingBox(Content=unflatten, Plane=PlaneXY(0, 0, 0), UnionBox=True)  # -> Box, Box_2
boxrec = BoxRectangle(Rectangle=bbox_2.Box, Height=厚み)
rec = Rectangle(bbox.Box)
sporph = Sporph(G=boxrec, S0=reparameterize(rec), P0="0,0", S1=reparameterize(srf), P1="0,0", R=False)

debrep = DeconstructBrep(Brep=sporph)  # -> Faces, Edges, Vertices
item_2 = ListItem(List=debrep.Faces, Index="3", Wrap=True)  # -> graft(Item)
popgeo = PopulateGeometry(Geometry=item_2, Count="20", Seed=1)
srf_cp = SurfaceClosestPoint(Point=popgeo, Surface=item_2)  # -> Point, UVPoint, Distance
evalsrf = EvaluateSurface(Surface=item_2, Point=srf_cp.UVPoint)  # -> Point, Normal, UDirection, VDirection, Frame
bbox_3 = BoundingBox(Content=sporph, Plane=evalsrf.Frame, UnionBox=True)  # -> Box, Box_2
debox = DeconstructBox(Box=bbox_3.Box)  # -> Plane, X, Y, Z
panel = Panel("""0
90
150
180
200
210
240
270
300""")
sort = SortList(Keys=debox.Z, ValuesA=bbox_3.Box)  # -> Keys, ValuesA
item_3 = ListItem(List=sort.ValuesA, Index=0, Wrap=True)
consec = ConsecutiveDomains(Numbers=panel, Additive=False)
debox_2 = DeconstructBox(Box=item_3)  # -> Plane, X, Y, Z
fdom = FindDomain(Domains=consec, Number=debox_2.Z, Strict=False)  # -> flatten(Index), Neighbour
dedomain = DeconstructDomain(Domain=consec)  # -> Start, End
index = ItemIndex(List=consec, Item=consec)
mindex_2 = MemberIndex(Set=fdom.Index, Member=index)  # -> Index, Count

box = EvaluateBox(Box=item_3, UParameter=0.5, VParameter=0.5, WParameter="0")  # -> Plane, Point, Include
orient = Orient(Geometry=sporph, Source=box.Plane, Target=PlaneXY(0, 0, 0))  # -> Geometry, Transform
item_4 = ListItem(List=flatten(orient.Geometry), Index=mindex_2.Index, Wrap=True)
item_5 = ListItem(List=flatten(sporph), Index=mindex_2.Index, Wrap=True)
rectangle = Rectangle(Plane=PlaneXY(0, 0, 0), XSize="910", YSize="1820", Radius=0)  # -> Rectangle, Length
drec = DeconstuctRectangle(Rectangle=rectangle.Rectangle)  # -> BasePlane, XInterval, YInterval
opennest = OpenNest(
    Sheets=rectangle.Rectangle,
    Geo=item_4,
    Spacing="50",
    Placement=1,
    Tolerance=0.1,
    Rotations=4,
    Iterations=1,
    Seed=1,
    Reset=True,
    Run=False)  # -> Sheets, Geo, ID, Transform, IDS
tstat_2 = TreeStatistics(Tree=item_4)  # -> Paths, Length, Count
num = Number(drec.YInterval)
addition = Addition(A=num, B="1000")
cset_2 = CreateSet(List=opennest.IDS)  # -> Set, Map
tstat_3 = TreeStatistics(Tree=opennest.IDS)  # -> Paths, Length, Count
series_3 = Series(Start=0, Step=addition, Count=tstat_2.Count)
series_4 = Series(Start=0, Step=1, Count=tstat_3.Count)  # -> graft(Series)
mindex_3 = MemberIndex(Set=opennest.IDS, Member=cset_2.Set)  # -> Index, Count
Y = UnitY(Factor=series_3)  # -> graft(UnitVector)
index_2 = ItemIndex(List=mindex_3.Index, Item=mindex_3.Index)
move = Move(Geometry=opennest.Sheets, Motion=Y)  # -> Geometry, Transform
move_2 = Move(Geometry=opennest.Geo, Motion=Y)  # -> Geometry, Transform
trim_2 = TrimTree(Tree=mindex_3.Index, Depth=1)
trim_3 = TrimTree(Tree=index_2, Depth=1)
format = Format(Format="{1}-{0}", Culture=127, Data0=opennest.IDS, Data1=series_4)
sort_2 = SortList(Keys=trim_2, ValuesA=trim_3)  # -> Keys, ValuesA
format_2 = Format(Format="{0}-{1}", Culture=127, Data0=format, Data1=sort_2.ValuesA)  # -> flatten(Text)
entwine = Entwine(Branch00=move_2.Geometry, Branch01=item_5, FlattenInputs=True)
debrep_2 = DeconstructBrep(Brep=entwine)  # -> Faces, Edges, Vertices
volume = Volume(Geometry=entwine)  # -> Volume, Centroid
tag = TextTag(Location=volume.Centroid, Text=format_2, Colour="black")
