# Grasshopper definition レンガ230607.gh (Grasshopper 1.0.7)
# plug-ins: OpenNest, MeshEdit Components

# ----
# *PackageManagerでOpenNest1.5.1をインストールする
number_slider = Slider(20, range=0..100)
厚み = Slider(200, range=0..1000)

足場回転 = ControlKnob(Decimals=0, Limit=True, Maximum=360, Minimum=0, Range=360, Value=0)
xy = XYPlane(Origin=Point(0, 0, 0))
prot = RotatePlane(Plane=xy, Angle=degrees(足場回転))

# ---- group: 足場向き
pln = Plane(prot)

# ----
足場大きさ縦横高さ = Panel("""1000
500
1800""")

srf = Surface(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)

recgrid = Rectangular(Plane=PlaneXY(0, 0, 0), SizeX="1", SizeY="1", ExtentX=number_slider, ExtentY=Slider(30, range=0..100))  # -> Cells, Points
tstat = TreeStatistics(Tree=recgrid.Cells)  # -> Paths, Length, Count
series = Series(Start=0, Step=1, Count=tstat.Count)
series_2 = Series(Start=series, Step=1, Count=tstat.Length)  # -> expr("x-x%2", Series)
cset = CreateSet(List=series_2)  # -> Set, Map
mindex = MemberIndex(Set=series_2, Member=cset.Set)  # -> Index, Count
trim = TrimTree(Tree=mindex.Index, Depth=1)
item = ListItem(List=recgrid.Cells, Index=trim, Wrap=True)
unflatten = UnflattenTree(Tree=item, Guide=mindex.Index)
bbox = BoundingBox(Content=flatten(item), Plane=PlaneXY(0, 0, 0), UnionBox=True)  # -> Box, Box_2
bbox_2 = BoundingBox(Content=unflatten, Plane=PlaneXY(0, 0, 0), UnionBox=True)  # -> Box, Box_2
boxrec = BoxRectangle(Rectangle=bbox_2.Box, Height=厚み)
rec = Rectangle(bbox.Box)
sporph = Sporph(G=boxrec, S0=reparameterize(rec), P0="0,0", S1=reparameterize(srf), P1="0,0", R=False)

debrep = DeconstructBrep(Brep=sporph)  # -> Faces, Edges, Vertices
item_2 = ListItem(List=debrep.Faces, Index="3", Wrap=True)  # -> graft(Item)
popgeo = PopulateGeometry(Geometry=item_2, Count="20", Seed=1)
srf_cp = SurfaceClosestPoint(Point=popgeo, Surface=item_2)  # -> Point, UVPoint, Distance
evalsrf = EvaluateSurface(Surface=item_2, Point=srf_cp.UVPoint)  # -> Point, Normal, UDirection, VDirection, Frame
bbox_3 = BoundingBox(Content=sporph, Plane=evalsrf.Frame, UnionBox=True)  # -> Box, Box_2
debox = DeconstructBox(Box=bbox_3.Box)  # -> Plane, X, Y, Z
panel = Panel("""0
90
150
180
200
210
240
270
300""")
sort = SortList(Keys=debox.Z, ValuesA=bbox_3.Box)  # -> Keys, ValuesA
item_3 = ListItem(List=sort.ValuesA, Index=0, Wrap=True)
consec = ConsecutiveDomains(Numbers=panel, Additive=False)
debox_2 = DeconstructBox(Box=item_3)  # -> Plane, X, Y, Z
fdom = FindDomain(Domains=consec, Number=debox_2.Z, Strict=False)  # -> flatten(Index), Neighbour
dedomain = DeconstructDomain(Domain=consec)  # -> Start, End
index = ItemIndex(List=consec, Item=consec)
mindex_2 = MemberIndex(Set=fdom.Index, Member=index)  # -> Index, Count

box = EvaluateBox(Box=item_3, UParameter=0.5, VParameter=0.5, WParameter="0")  # -> Plane, Point, Include
orient = Orient(Geometry=sporph, Source=box.Plane, Target=PlaneXY(0, 0, 0))  # -> Geometry, Transform
item_4 = ListItem(List=flatten(orient.Geometry), Index=mindex_2.Index, Wrap=True)
item_5 = ListItem(List=flatten(sporph), Index=mindex_2.Index, Wrap=True)
rectangle = Rectangle(Plane=PlaneXY(0, 0, 0), XSize="910", YSize="1820", Radius=0)  # -> Rectangle, Length
drec = DeconstuctRectangle(Rectangle=rectangle.Rectangle)  # -> BasePlane, XInterval, YInterval
opennest = OpenNest(
    Sheets=rectangle.Rectangle,
    Geo=item_4,
    Spacing="50",
    Placement=1,
    Tolerance=0.1,
    Rotations=4,
    Iterations=1,
    Seed=1,
    Reset=True,
    Run=False)  # -> Sheets, Geo, ID, Transform, IDS
tstat_2 = TreeStatistics(Tree=item_4)  # -> Paths, Length, Count
num = Number(drec.YInterval)
addition = Addition(A=num, B="1000")
cset_2 = CreateSet(List=opennest.IDS)  # -> Set, Map
tstat_3 = TreeStatistics(Tree=opennest.IDS)  # -> Paths, Length, Count
series_3 = Series(Start=0, Step=addition, Count=tstat_2.Count)
series_4 = Series(Start=0, Step=1, Count=tstat_3.Count)  # -> graft(Series)
mindex_3 = MemberIndex(Set=opennest.IDS, Member=cset_2.Set)  # -> Index, Count
Y = UnitY(Factor=series_3)  # -> graft(UnitVector)
index_2 = ItemIndex(List=mindex_3.Index, Item=mindex_3.Index)
move = Move(Geometry=opennest.Sheets, Motion=Y)  # -> Geometry, Transform
move_2 = Move(Geometry=opennest.Geo, Motion=Y)  # -> Geometry, Transform
trim_2 = TrimTree(Tree=mindex_3.Index, Depth=1)
trim_3 = TrimTree(Tree=index_2, Depth=1)
format = Format(Format="{1}-{0}", Culture=127, Data0=opennest.IDS, Data1=series_4)
sort_2 = SortList(Keys=trim_2, ValuesA=trim_3)  # -> Keys, ValuesA
format_2 = Format(Format="{0}-{1}", Culture=127, Data0=format, Data1=sort_2.ValuesA)  # -> flatten(Text)
entwine = Entwine(Branch00=move_2.Geometry, Branch01=item_5, FlattenInputs=True)
debrep_2 = DeconstructBrep(Brep=entwine)  # -> Faces, Edges, Vertices
volume = Volume(Geometry=entwine)  # -> Volume, Centroid
tag = TextTag(Location=volume.Centroid, Text=format_2, Colour="black")

orient_2 = Orient(Source=pln, Target="WorldXY")  # -> Geometry, Transform
transform = Transform(Geometry=sporph, Transform=orient_2.Transform)
inverse = InverseTransform(Transform=orient_2.Transform)
geo = Geometry([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])
bbox_4 = BoundingBox(Content=geo, Plane=PlaneXY(0, 0, 0), UnionBox=True)  # -> Box, Box_2

bbox_5 = BoundingBox(Content=flatten(transform), Plane=pln, UnionBox=True)  # -> Box, Box_2
debox_3 = DeconstructBox(Box=bbox_5.Box)  # -> Plane, X, Y, Z
entwine_2 = Entwine(Branch00=debox_3.X, Branch01=debox_3.Y, Branch02=debox_3.Z, FlattenInputs=True)
num_2 = Number(graft(足場大きさ縦横高さ))
panel_2 = Panel("""1
1
0""")
multiplication = Multiplication(A=graft(panel_2), B=num_2)
dedomain_2 = DeconstructDomain(Domain=entwine_2)  # -> Start, End
subtraction = Subtraction(A=dedomain_2.Start, B=multiplication)
addition_2 = Addition(A=multiplication, B=dedomain_2.End)
dom = ConstructDomain(DomainStart=subtraction, DomainEnd=addition_2)
num_3 = Number(dom)
division = Division(A=num_3, B=num_2)
div = DivideDomain(Domain=dom, Count=division)
bang = ExplodeTree(Data=div)  # -> Branch0, Branch1, Branch2
crossref = CrossReference(ListA=bang.Branch0, ListB=bang.Branch1, ListC=bang.Branch2, CrossMode=1)  # -> ListA, ListB, ListC
box_2 = DomainBox(Base="WorldXY", X=crossref.ListA, Y=crossref.ListB, Z=crossref.ListC)

orient_3 = Orient(Source="WorldXY", Target=debox_3.Plane)  # -> Geometry, Transform
transform_2 = Transform(Geometry=box_2, Transform=orient_3.Transform)
comp = Compound(Transforms=[orient_3.Transform, inverse])
colom = CollisionOneMany(Collider=transform, Obstacles=transform_2)  # -> Collision, Index
cull = CullPattern(List=colom.Index, CullPattern=colom.Collision)
cset_3 = CreateSet(List=flatten(cull))  # -> Set, Map
cull_i = CullIndex(List=box_2, Indices=cset_3.Set, Wrap=True)
morph = BoxMorph(Geometry=geo, Reference=bbox_4.Box, Target=graft(cull_i))
c_script = CSharpScript(x=morph)  # -> A
# ---------- c_script: C# ----------
    A = x is Curve;
# ---------- end c_script ----------
cull_2 = CullPattern(List=morph, CullPattern=c_script)
unit = UnitVector(Vector=cull_2)
abs = Absolute(Value=unit)
cp = ClosestPoint(Point=abs, Cloud="0,0,1")  # -> ClosestPoint, CPIndex, Distance
smaller = SmallerThan(FirstNumber="1E-3", SecondNumber=cp.Distance)  # -> SmallerThan, OrEqualTo
cull_3 = CullPattern(List=cull_2, CullPattern=smaller.SmallerThan)
debrep_3 = DeconstructBrep(Brep=cull_i)  # -> Faces, Edges, Vertices
midpt = CurveMiddle(Curve=cull_3)

volume_2 = Volume(Geometry=cull_i)  # -> Volume, Centroid
del3d = _3DDelaunay(Points=volume_2.Centroid)  # -> TopologicalEdges, Connectivity
end = EndPoints(Curve=graft(del3d.TopologicalEdges))  # -> Start, End
cp_2 = ClosestPoint(Point=[end.End, end.Start], Cloud=volume_2.Centroid)  # -> ClosestPoint, CPIndex, Distance
unit_2 = UnitVector(Vector=del3d.TopologicalEdges)
item_6 = ListItem(List=cull_i, Index=cp_2.CPIndex, Wrap=True)
panel_3 = Panel("""1,0,0
0,1,0""")
colmm = CollisionManyMany(Colliders=item_6)  # -> Collision, Indices
abs_2 = Absolute(Value=unit_2)
cset_4 = CreateSet(List=colmm.Collision)  # -> flatten(Set), Map
cp_3 = ClosestPoint(Point=abs_2, Cloud=panel_3)  # -> ClosestPoint, CPIndex, Distance
larger = LargerThan(FirstNumber="1E-3", SecondNumber=cp_3.Distance)  # -> LargerThan, OrEqualTo
and = GateAnd(A=larger.OrEqualTo, B=cset_4.Set)
cull_4 = CullPattern(List=del3d.TopologicalEdges, CullPattern=and)

colom_2 = CollisionOneMany(Collider=debrep_3.Faces, Obstacles=cull_4)  # -> Collision, Index
cull_5 = CullPattern(List=debrep_3.Faces, CullPattern=colom_2.Collision)
crossref_2 = CrossReference(ListA=midpt, ListB=cull_5, CrossMode=1)  # -> ListA, ListB
brep_cp = BrepClosestPoint(Point=crossref_2.ListA, Brep=crossref_2.ListB)  # -> Point, Normal, Distance
larger_2 = LargerThan(FirstNumber="1E-3", SecondNumber=brep_cp.Distance)  # -> LargerThan, OrEqualTo
cull_6 = CullPattern(List=crossref_2.ListA, CullPattern=larger_2.LargerThan)
index_3 = ItemIndex(List=midpt, Item=cull_6)
cset_5 = CreateSet(List=index_3)  # -> Set, Map
item_7 = ListItem(List=cull_3, Index=cset_5.Set, Wrap=True)
index_4 = ItemIndex(List=morph, Item=item_7)
cull_i_2 = CullIndex(List=morph, Indices=index_4, Wrap=True)
transform_3 = Transform(Geometry=cull_i_2, Transform=comp)
