# Grasshopper definition yane.gh (Grasshopper 1.0.7)
# plug-ins: Kangaroo2 Components

pt = Point([Point(-1269.767967, -2455.905536, 0), Point(6789.999444, -179.0898107, 0), Point(6942.863515, -1565.005019, 0)])
pt_2 = Point(Point(1886.408501, 622.3712855, 0))
circle = Circle({Plane=Plane(origin=(2223.757974, -1777.938831, 0), x=(0.1034030573, -0.9946395366, 0), y=(0.9946395366, 0.1034030573, 0)), Radius=1398.785332})

# ----
# 019
panel = Panel("100")
qrsettings = QuadRemeshSettings(TargetCount=panel, AdaptiveSize=0, AdaptiveCount=False, HardEdges=False, SeamEdges=0, Symmetry=0, GuideCurves=0)
metaball = MetaBall(Points=pt, Plane=PlaneXY(0, 0, 0), Point=pt_2)
qrmesh = QuadRemesh(Mesh=metaball, Settings=qrsettings)
demesh = DeconstructMesh(Mesh=qrmesh)  # -> Vertices, Faces, Colours, Normals
incurve = PointInCurve(Point=demesh.Vertices, Curve=circle)  # -> Relationship, Point
cull = CullPattern(List=demesh.Vertices, CullPattern=incurve.Relationship)
nv = NakedVertices(Mesh=qrmesh)  # -> ClothedIndex, NakedIndex, ClothedPts, NakedPts
edgelengths = EdgeLengths(Mesh=qrmesh, LengthFactor=1, Strength=1)
anchor = Anchor(Point=nv.NakedPts, Strength=10000)
pressure = Pressure(M=qrmesh, Strength="-1E-4")
anchor_2 = Anchor(Point=cull, Strength="4E-2")
show = Show(G=qrmesh)
entwine = Entwine(Branch00=show, Branch01=[edgelengths, pressure, anchor, anchor_2], FlattenInputs=True)
zombiesolver = ZombieSolver(GoalObjects=entwine, Threshold=1e-10, Tolerance=0.0001, MaxIterations=50000)  # -> I, V, O
item = ListItem(List=zombiesolver.O, Index=0, Wrap=True)
subdmesh = SubDFromMesh(Mesh=item, Creases=1, Corners=1, Interpolate=False)

# ----
# 020
subdedges = SubDEdges(SubD=subdmesh, NewFormatting=False)  # -> Line, Edge, Tag, Id
brep = Brep(subdmesh)
panel_2 = Panel("""0
pi/4""")
rotate = Rotate(Angle=panel_2, Plane=PlaneXY(0, 0, 0))  # -> Geometry, graft(Transform)
tmatch = MatchText(Text=subdedges.Tag, RegEx="naked", Case=True)
popgeo = PopulateGeometry(Geometry=brep, Count="500", Seed=1)
cull_2 = CullPattern(List=subdedges.Edge, CullPattern=tmatch)
transform = Transform(Geometry=popgeo, Transform=rotate.Transform)
join = JoinCurves(Curves=cull_2, Preserve=False)
patch = Patch(Points=transform, Spans="100", Flexibility=1, Trim=True)
inverse = InverseTransform(Transform=rotate.Transform)
transform_2 = Transform(Geometry=patch, Transform=inverse)
pull = PullCurve(Curve=join, Surface=transform_2)
srfsplit = SurfaceSplit(Surface=transform_2, Curves=pull)
area = Area(Geometry=srfsplit)  # -> Area, Centroid
brep_cp = BrepClosestPoint(Point=area.Centroid, Brep=srfsplit)  # -> Point, Normal, Distance
sort = SortList(Keys=brep_cp.Distance, ValuesA=srfsplit)  # -> Keys, ValuesA
item_2 = ListItem(List=sort.ValuesA, Index=0, Wrap=True)
dim = Dimensions(Surface=item_2)  # -> UDimension, VDimension
division = Division(A=dim.UDimension, B="300")
division_2 = Division(A=dim.VDimension, B="300")
mesh_uv = MeshSurface(Surface=item_2, UCount=division, VCount=division_2, Overhang="false", Equalize=False)
warpweft = WarpWeft(Mesh=mesh_uv)  # -> Warp, Weft, NakedA, NakedB
