# Grasshopper definition guruguru.gh (Grasshopper 1.0.7)

knob = ControlKnob(Decimals=0, Limit=True, Maximum=360, Minimum=0, Range=360, Value=290)
line = LineSDL(Start="0,0", Direction="1,0", Length="1")
number_slider = Slider(0.613, range=0..1)
rotate = Rotate(Geometry=line, Angle=degrees(knob), Plane=PlaneXY(0, 0, 0))  # -> Geometry, Transform
maelstrom = Maelstrom(
    Geometry=rotate.Geometry,
    Plane=PlaneXY(0, 0, 0),
    First=number_slider,
    Second=number_slider,
    Angle=degrees(Slider(1000, range=0..1000)),
    Rigid=False)

trigger = Trigger(Interval=5, TimerInterval=5, Target=c_script)  # disabled
c_script = CSharpScript(x=Toggle(True))  # inputs x: Boolean
# ---------- c_script: C# usings ----------
using Knob = Grasshopper.Kernel.Special.GH_DialKnob;
# ---------- c_script: C# ----------
    if(x)
    {
      Grasshopper.Kernel.Special.GH_DialKnob knob = GrasshopperDocument.FindObject(new Guid("22e20b13-589e-4370-a82f-e094d02faafe"), true) as Knob;
      knob.Value = (knob.Value + 10) % 360;
      knob.ComputeData();
      knob.ExpireSolution(true);
    }
# ---------- end c_script ----------

rec = Rectangle({Plane=PlaneXY(50.95585738, -5.909198941, 0), Size=Domain2(u=-964.585379..964.585379, v=-1046.655074..1046.655074)})
pop2d = Populate2D(Region=rec, Count=Slider(595, range=0..1000), Seed=1)
scale = Scale(Geometry=maelstrom, Center=Point(0, 0, 0), Factor=Slider(3133, range=0..10000))  # -> Geometry, Transform
voronoi = Voronoi(Points=pop2d, Boundary=rec, BruteForceOverride=False)
crv_cp = CurveClosestPoint(Point=pop2d, Curve=scale.Geometry)  # -> Point, Parameter, Distance
bnd = Bounds(Numbers=crv_cp.Distance)
remap = RemapNumbers(Value=crv_cp.Distance, Source=bnd, Target=Domain(0, 1))  # -> Mapped, Clipped
gradient = Gradient(LowerLimit=0, UpperLimit=1, Parameter=remap.Mapped, stops=[0: RGB(255, 255, 255), 1: RGB(0, 0, 0)])
mesh = Mesh(voronoi)
mcol = MeshColours(Mesh=graft(mesh), Colours=graft(gradient))
