# Grasshopper definition cool.gh (Grasshopper 1.0.7)

recgrid = Rectangular(Plane=PlaneXY(0, 0, 0), SizeX="3", SizeY="3", ExtentX="21", ExtentY="21")  # -> Cells, graft(Points)

avr = Average(Input=flatten(recgrid.Points))
subtraction = Subtraction(A=recgrid.Points, B=avr)
angle = Angle(VectorA=subtraction, VectorB="1,0,0", Plane="WorldXY")  # -> Angle, Reflex
vlen = VectorLength(Vector=subtraction)
bnd = Bounds(Numbers=flatten(vlen))
pi = Pi(Factor=Slider(1, range=0..10))
deg = Degrees(Radians=angle.Angle)
remap = RemapNumbers(Value=vlen, Source=bnd, Target=pi)  # -> Mapped, Clipped
eval = Evaluate(F="(360*(sin(x)^2)+y*2)%720", x=remap.Mapped, y=deg)

qrsettings = QuadRemeshSettings(TargetCount="500", AdaptiveSize=0, AdaptiveCount=False, HardEdges=False, SeamEdges=0, Symmetry=0, GuideCurves=0)
cir = Circle(Plane="WorldXY", Radius="1")
qrmesh = QuadRemesh(Mesh=cir, Settings=qrsettings)
demesh = DeconstructMesh(Mesh=qrmesh)  # -> Vertices, Faces, Colours, Normals
xz = XZPlane(Origin="0,1")
cp = PlaneClosestPoint(Point=demesh.Vertices, Plane=xz)  # -> Point, UVPoint, Distance

prot = RotatePlane(Plane=recgrid.Points, Angle=degrees(eval))

lng = ListLength(List=demesh.Vertices)
range = Range(Domain="0 To 1", Steps=expr("x-1", lng))
sort = SortList(Keys=cp.Distance, ValuesA=cp.Distance)  # -> Keys, ValuesA
eval_2 = Evaluate(F="sin((x/720)*pi)", x=eval)
larger = LargerThan(FirstNumber=eval_2, SecondNumber=range)  # -> LargerThan, OrEqualTo
panel = Panel("""true
false""")
index = ItemIndex(List=sort.ValuesA, Item=cp.Distance)
bool = Boolean(panel)
relay = Relay([ColourSwatch(SwatchColor=RGB(255, 255, 255)), ColourSwatch(SwatchColor=RGB(0, 0, 0))])
keysearch = KeyValueSearch(Keys=bool, Values=relay, Search=larger.LargerThan)
item = ListItem(List=keysearch, Index=index, Wrap=True)

eval_3 = Evaluate(F="if(x/360>1,0,1)", x=eval)
index_2 = ItemIndex(List=demesh.Vertices, Item=demesh.Vertices)

mcol = MeshColours(Mesh=qrmesh, Colours=item)
mblur = BlurMesh(Mesh=mcol, Iterations="1")
demesh_2 = DeconstructMesh(Mesh=mblur)  # -> Vertices, Faces, Colours, Normals
mindex = MemberIndex(Set=demesh_2.Colours, Member=relay)  # -> Index, Count
panel_2 = Panel("""0
1""")
trim = TrimTree(Tree=mindex.Index, Depth=1)
int = Integer(panel_2)
difference = SetDifference(SetA=index_2, SetB=trim)
keysearch_2 = KeyValueSearch(Keys=int, Values=[ColourSwatch(SwatchColor=RGB(255, 144, 0)), ColourSwatch(SwatchColor=RGB(0, 149, 255))], Search=eval_3)
replace = ReplaceItems(List=demesh_2.Colours, Item=keysearch_2, Indices=difference, Wrap=False)
mcol_2 = MeshColours(Mesh=mblur, Colours=replace)
mblur_2 = BlurMesh(Mesh=mcol_2, Iterations="5")

orient = Orient(Geometry=mblur_2, Source=PlaneXY(0, 0, 0), Target=prot)  # -> Geometry, Transform
transform = Transform(Geometry=cir, Transform=orient.Transform)
preview = CustomPreview(Geometry=transform, Material="black")
