# Grasshopper definition imageMesh.gh (Grasshopper 1.0.7)
# plug-ins: Kangaroo2 Components

instanceguid_of_imagesampler = Panel("97f73f66-3a7f-4ef2-a1da-2cf5643be222")
click_to_set_a_image_in_your_folder = Button()
c_script = CSharpScript(extention=".jpg")  # -> firstImagePath; inputs extention: String
# ---------- c_script: C# usings ----------
using System.IO;
using System.Linq;
# ---------- c_script: C# ----------
    Random rd = new Random();
  
    string dir = Path.GetDirectoryName(this.GrasshopperDocument.FilePath);
    firstImagePath = Directory.GetFiles(dir).OrderBy(p=> rd.Next()).FirstOrDefault(p => Path.GetExtension(p) == extention);
# ---------- end c_script ----------
c_script_2 = CSharpScript(path=c_script)  # -> fileName; inputs path: String
# ---------- c_script_2: C# usings ----------
using System.IO;
# ---------- c_script_2: C# ----------
    fileName = Path.GetFileName(path);
# ---------- end c_script_2 ----------
number_slider = Slider(20, range=0..100)
c_script_3 = CSharpScript(image=c_script)  # -> size; inputs image: String
# ---------- c_script_3: C# usings ----------
using System.Drawing;
# ---------- c_script_3: C# ----------
    var bitmap = Image.FromFile(image);
    size = new Rectangle3d(Plane.WorldXY, bitmap.Width, bitmap.Height);
# ---------- end c_script_3 ----------
panel = Panel(c_script_2)
c_script_4 = CSharpScript(toggle=click_to_set_a_image_in_your_folder, id=instanceguid_of_imagesampler, image=c_script)  # -> A; inputs toggle: Boolean, id: Guid, image: String
# ---------- c_script_4: C# usings ----------
using System.Reflection;
using Image = Grasshopper.Kernel.Special.GH_ImageSampler;
# ---------- c_script_4: C# ----------
    if(toggle)
    {
      var item = this.GrasshopperDocument.FindObject(id, true) as Image;
      item.ImageFilePath = image;
      var method = typeof(Image).GetMethod("ReloadImage", BindingFlags.Instance | BindingFlags.NonPublic);
      method.Invoke(item, null);
      item.ExpireSolution(true);
    }
# ---------- end c_script_4 ----------
sdivide = DivideSurface(Surface=reparameterize(c_script_3), UCount=number_slider, VCount=number_slider)  # -> Points, Normals, Parameters
mesh_uv = MeshSurface(Surface=c_script_3, UCount=number_slider, VCount=number_slider, Overhang=True, Equalize=False)
area = Area(Geometry=c_script_3)  # -> Area, Centroid
image = ImageSampler(
    sdivide.Parameters,
    FilePath="C:\Users\ktner\Downloads\100d-gh\stock4\Jean-François_Millet_-_Gleaners_-_Google_Art_Project_2.jpg",
    Filter="Colour",
    Interpolate=False,
    Umax=1,
    Umin=0,
    Vmax=1,
    Vmin=0,
    Wrap=1)
panel_2 = Panel("""0.01
0.1""")
mcol = MeshColours(Mesh=mesh_uv, Colours=flatten(image))
explode = Explode(Curve=c_script_3, Recursive=True)  # -> Segments, Vertices
eval = Evaluate(F="SQRT(x)", x=area.Area)
multiplication = Multiplication(A=panel_2, B=eval)
consec = ConsecutiveDomains(Numbers=multiplication, Additive=False)
remeshbycolour = RemeshByColour(
    Mesh=mcol,
    LengthInterval=consec,
    FixCurves=explode.Segments,
    FixVertices=explode.Vertices,
    Flip=1,
    Iterations=Slider(20, range=0..100),
    Reset=Button())
medges = MeshEdges(Mesh=remeshbycolour)  # -> NakedEdges, InteriorEdges, NonManifoldEdges
