# Grasshopper definition kochoshinobu.gh (Grasshopper 1.0.7)

recgrid = Rectangular(Plane=PlaneXY(0, 0, 0), SizeX="1", SizeY="4", ExtentX=Slider(120, range=0..1000), ExtentY=Slider(20, range=0..100))  # -> Cells, Points
disc = Discontinuity(Curve=recgrid.Cells, Level=1)  # -> Points, Parameters
tstat = TreeStatistics(Tree=recgrid.Points)  # -> Paths, Length, Count
series = Series(Start=0, Step=1, Count=tstat.Count)
cp = ClosestPoint(Point=disc.Points, Cloud=flatten(recgrid.Points))  # -> ClosestPoint, CPIndex, Distance
series_2 = Series(Start=series, Step=1, Count=tstat.Length)  # -> expr("x%2", Series)
Y = UnitY(Factor=series_2)
move = Move(Geometry=recgrid.Points, Motion=Y)  # -> flatten(Geometry), Transform
item = ListItem(List=move.Geometry, Index=cp.CPIndex, Wrap=True)
pline = PolyLine(Vertices=item, Closed=True)
srf = Surface(pline)
join = BrepJoin(Breps=flatten(srf))  # -> Breps, Closed
smesh = SimpleMesh(Brep=join.Breps)
demesh = DeconstructMesh(Mesh=smesh)  # -> Vertices, Faces, Colours, Normals
medges = MeshEdges(Mesh=smesh)  # -> NakedEdges, InteriorEdges, NonManifoldEdges
pdecon = Deconstruct(Point=demesh.Vertices)  # -> XComponent, YComponent, ZComponent
relay = Relay([medges.NakedEdges, medges.InteriorEdges, medges.NonManifoldEdges])
bnd = Bounds(Numbers=pdecon.YComponent)
len = Length(Curve=relay)
dedomain = DeconstructDomain(Domain=bnd)  # -> Start, End
gradient = Gradient(
    LowerLimit=dedomain.Start,
    UpperLimit=dedomain.End,
    Parameter=pdecon.YComponent,
    stops=[0: RGB(232, 135, 152), 0.495: RGB(184, 217, 198), 1: RGB(255, 255, 255)])
equals = Equality(FirstNumber=len, SecondNumber="5")  # -> Equality, Inequality
cull = CullPattern(List=relay, CullPattern=equals.Inequality)
preview = CustomPreview(Geometry=cull, Material="gray")
mcol = MeshColours(Mesh=smesh, Colours=gradient)
