# Grasshopper definition Metropol Parasol.gh (Grasshopper 1.0.7)

# ---- group: input
brep = Brep(<brep referenced from the Rhino model>)

# ----
グリッド間隔 = Slider(1000, range=0..10000)
X = UnitX(Factor=1)
Y = UnitY(Factor=1)
# ←ワッフルを作る
contour = Contour(Shape=brep, Point=Point(0, 0, 0), Direction=[X, Y], Distance=グリッド間隔)
trim = TrimTree(Tree=contour, Depth=1)
boundary = BoundarySurfaces(Edges=trim)

# ---- group: output
# ワッフルにスリットを作る→
srf = Surface(boundary)

# ---- group: ワッフルのリスト構造を使って、ワッフルの交差線を取る
bang = ExplodeTree(Data=srf)  # -> Branch0, Branch1
bbx = BrepBrep(BrepA=graft(bang.Branch0), BrepB=bang.Branch1)  # -> Curves, Points

# ----
ワッフルの厚み_スリット幅 = Panel("-25 To 25")
domain = Domain(ワッフルの厚み_スリット幅)

# ---- group: 交差線の長さでボックスを作る
eval = EvaluateLength(Curve=bbx.Curves, Length="0", Normalized=True)  # -> Point, Tangent, Parameter
pl = PlaneNormal(Origin=eval.Point, ZAxis=eval.Tangent)
len = Length(Curve=bbx.Curves)
domain_2 = Domain(domain)
box = DomainBox(Base=pl, X=domain_2, Y=domain_2, Z=len)

# ---- group: ボックスを一度グループにまとめて、グリッドに分配する
group = Group(Objects=box)
trim_2 = TrimTree(Tree=group, Depth=1)
flip = FlipMatrix(Data=trim_2)
ungroup = Ungroup(Group=trim_2)
ungroup_2 = Ungroup(Group=flip)
trim_3 = TrimTree(Tree=ungroup, Depth=1)
trim_4 = TrimTree(Tree=ungroup_2, Depth=1)

# ---- group: XY方向にそれぞれ1/2と-1/2の数字をその数作る
tstat = TreeStatistics(Tree=trim_3)  # -> Paths, Length, Count
tstat_2 = TreeStatistics(Tree=trim_4)  # -> Paths, Length, Count
dup = DuplicateData(Data="1/2", Number=tstat.Length, Order=True)
dup_2 = DuplicateData(Data="-1/2", Number=tstat_2.Length, Order=True)
entwine = Entwine(Branch0X=dup, Branch1X=dup_2, FlattenInputs=False)

# ----
entwine_2 = Entwine(Branch0X=trim_3, Branch1X=trim_4, FlattenInputs=False)

# ---- group: 数字を使ってボックスをZ方向に動かす
debox = DeconstructBox(Box=entwine_2)  # -> Plane, X, Y, Z
Z = UnitZ(Factor=debox.Z)
multiplication = Multiplication(A=Z, B=entwine)
move = Move(Geometry=entwine_2, Motion=multiplication)  # -> Geometry, Transform

# ----
graft = GraftTree(Tree=srf, IncludeEmptyLists=True, IncludeNullItems=True)

# ---- group: ボックスを使って板を切る
trim_5 = TrimSolid(Shape=graft, Cutters=move.Geometry)  # -> flatten(Result)

# ---- group: 板の法線方向を取って、厚みをつける
planar = IsPlanar(Surface=trim_5, Interior=True)  # -> Planar, Plane
num = Number(domain)
deplane = DeconstructPlane(Plane=planar.Plane)  # -> Origin, XAxis, YAxis, ZAxis
multiplication_2 = Multiplication(A=deplane.ZAxis, B=num)
extr = Extrude(Base=trim_5, Direction=multiplication_2)
division = Division(A=multiplication_2, B="-1/2")
move_2 = Move(Geometry=extr, Motion=division)  # -> Geometry, Transform

# ---- group: output
brep_2 = Brep(move_2.Geometry)
