# Grasshopper definition guruguru.gh (Grasshopper 1.0.7)

recgrid = Rectangular(Plane=PlaneXY(0, 0, 0), SizeX="5", SizeY="5", ExtentX="13", ExtentY="13")  # -> Cells, Points
tstat = TreeStatistics(Tree=recgrid.Points)  # -> Paths, Length, Count
data = Data(flatten(recgrid.Points))
series = Series(Start=0, Step=1, Count=tstat.Count)
avr = Average(Input=data)
series_2 = Series(Start=series, Step=1, Count=tstat.Length)  # -> flatten(Series)
subtraction = Subtraction(A=data, B=avr)
xy = XYPlane(Origin=Point(0, 0, 0))
multiplication = Multiplication(A=series_2, B="pi/2")
angle = Angle(VectorA="1,0", VectorB=subtraction, Plane=xy)  # -> Angle, Reflex
vlen = VectorLength(Vector=subtraction)
neg = Negative(Value=Slider(0, range=0..1))
prot = RotatePlane(Plane=data, Angle=multiplication)
eval = Evaluate(F="(x%y)/y+z/(2*pi)+u", x=vlen, y="50", z=angle.Angle, u=neg)
arc = Arc(Plane="-1.2,0", Radius="1", Angle="0 To pi")  # -> Arc, Length
line = LineSDL(Start="0,0.2", Direction="0,0.2", Length="2")
eval_2 = Evaluate(F="round((sin((x%1)*pi)^2),1)", x=eval)
divide = DivideCurve(Curve=line, Count=10, Kinks=False)  # -> Points, Tangents, Parameters
divide_2 = DivideCurve(Curve=arc.Arc, Count=10, Kinks=False)  # -> Points, Tangents, Parameters
cset = CreateSet(List=eval_2)  # -> Set, Map
mindex = MemberIndex(Set=eval_2, Member=cset.Set)  # -> Index, Count
arc_2 = ArcSED(Start=divide.Points, End=divide_2.Points, Direction="-1,0")  # -> Arc, Plane, Radius
pl = PlaneNormal(Origin=Point(0, 0, 0), ZAxis="1,1")
mirror = Mirror(Geometry=arc_2.Arc, Plane=pl)  # -> Geometry, Transform
graft = GraftTree(Tree=cset.Set, IncludeEmptyLists=True, IncludeNullItems=True)
item = ListItem(List=prot, Index=mindex.Index, Wrap=True)
gradient = Gradient(
    LowerLimit=0,
    UpperLimit=1,
    Parameter=graft,
    stops=[0: RGB(0, 128, 0), 0.543: RGB(255, 255, 0), 0.803: RGB(255, 255, 0), 1: RGB(255, 0, 0)])
eval_3 = EvaluateLength(Curve=arc_2.Arc, Length=expr("1-x", graft), Normalized=True)  # -> Point, Tangent, Parameter
eval_4 = EvaluateLength(Curve=mirror.Geometry, Length=graft, Normalized=True)  # -> Point, Tangent, Parameter
xz = XZPlane(Origin="0,0")
yz = YZPlane(Origin="0,0")
move = Move(Motion="0,0")  # -> Geometry, Transform
mirror_2 = Mirror(Plane=xz)  # -> Geometry, Transform
mirror_3 = Mirror(Plane=yz)  # -> Geometry, Transform
intcrv = Interpolate(Vertices=eval_3.Point, Degree=3, Periodic=False, KnotStyle=1)  # -> Curve, Length, Domain
intcrv_2 = Interpolate(Vertices=eval_4.Point, Degree=3, Periodic=False, KnotStyle=1)  # -> Curve, Length, Domain
matrix = Matrix(move.Transform)
matrix_2 = Matrix(mirror_2.Transform)
matrix_3 = Matrix(mirror_3.Transform)
rulesrf = RuledSurface(CurveA=intcrv.Curve, CurveB=intcrv_2.Curve)
multiplication_2 = Multiplication(A=graft([matrix_2, matrix]), B=[matrix_3, matrix])  # -> flatten(Result)
mcol = MeshColours(Mesh=rulesrf, Colours=graft(gradient))
transform = Transform(Geometry=mcol, Transform=multiplication_2)
crossref = CrossReference(ListA=item, ListB=transform, CrossMode=1)  # -> ListA, ListB
orient = Orient(Geometry=crossref.ListB, Source=PlaneXY(0, 0, 0), Target=crossref.ListA)  # -> Geometry, Transform

data_2 = Data(orient.Geometry)
