# Grasshopper definition 変形.gh (Grasshopper 1.0.7)
# plug-ins: Kangaroo2 Components

rec = Rectangle({Plane=PlaneXY(3736.825101, -11937.5852, 0), Size=Domain2(u=-14806.77942..14806.77942, v=-9689.730651..9689.730651)})
rec_2 = Rectangle({Plane=PlaneXY(-20269.75477, 27202.39422, 0), Size=Domain2(u=-38595.61254..38595.61254, v=-24768.69352..24768.69352)})
merge = Merge(Data1=rec, Data2=rec_2)
mesh = Mesh(merge)
triremesh = TriRemesh(Geometry=mesh, Sharp=False, Length=Slider(6000, range=0..10000), Iterations=25)  # -> Triangulation, Dual, Creases

faceb = FaceBoundaries(Mesh=triremesh.Triangulation)
explode = Explode(Curve=faceb, Recursive=True)  # -> Segments, Vertices
len = Length(Curve=explode.Segments)
bang = ExplodeTree(Data=faceb)  # -> Branch0, Branch1
item = ListItem(List=len, Index=0, Wrap=True)  # -> Item, Item1, Item2
pt = ConstructPoint(XCoordinate=item.Item, YCoordinate=item.Item1, ZCoordinate=item.Item2)  # -> flatten(Point)
index = ItemIndex(List=flatten(faceb), Item=bang.Branch0)
cull_i = CullIndex(List=pt, Indices=index, Wrap=True)
item_2 = ListItem(List=pt, Index=index, Wrap=True)
fsim = FindSimilarMember(Data=cull_i, Set=item_2)  # -> Hit, Index

cull_i_2 = CullIndex(List=flatten(faceb), Indices=index, Wrap=True)

pdecon = Deconstruct(Point=graft(fsim.Hit))  # -> XComponent, YComponent, ZComponent
merge_2 = Merge(Data1=pdecon.XComponent, Data2=pdecon.YComponent, Data3=pdecon.ZComponent)
explode_2 = Explode(Curve=cull_i_2, Recursive=True)  # -> Segments, Vertices
length_line = LengthLine(Line=explode_2.Segments, Length=merge_2, Strength=10)

show = Show(G=triremesh.Triangulation)
entwine = Entwine(Branch00=show, Branch01=length_line, FlattenInputs=True)
solver = Solver(GoalObjects=entwine, Reset=Button(), Threshold=1e-15, Tolerance=0.0001, On=Toggle(True))  # -> I, V, O
bang_2 = ExplodeTree(Data=solver.O)  # -> Branch0, Branch1
faceb_2 = FaceBoundaries(Mesh=bang_2.Branch0)
srf = Surface(faceb_2)

index_2 = ItemIndex(List=item_2, Item=item_2)
entwine_2 = Entwine(Branch00=index_2, Branch01=fsim.Index, FlattenInputs=True)
bnd = Bounds(Numbers=entwine_2)
dedomain = DeconstructDomain(Domain=bnd)  # -> Start, End
gradient = Gradient(
    LowerLimit=dedomain.Start,
    UpperLimit=dedomain.End,
    Parameter=entwine_2,
    stops=[0: RGB(243, 57, 0), 0.1: RGB(236, 27, 60), 0.2: RGB(210, 0, 118), 0.3: RGB(103, 0, 120), 0.4: RGB(39, 72, 161), 0.5: RGB(1, 192, 229), 0.6: RGB(18, 178, 90), 0.7: RGB(79, 186, 8), 0.8: RGB(220, 237, 32), 0.9: RGB(247, 159, 20), 1: RGB(255, 255, 255)])
material = CreateMaterial(Diffuse=gradient, Specular=RGB(255, 255, 255), Emission=RGB(0, 0, 0), Transparency=0, Shine=0)
preview = CustomPreview(Geometry=srf, Material=material)

area = Area(Geometry=srf)  # -> Area, Centroid
tag = TextTag3D(Location=area.Centroid, Text=entwine_2, Size="1000", Justification=5)
