# Grasshopper definition Serpentine1.gh (Grasshopper 1.0.7)
# plug-ins: Kangaroo2 Components

knob = ControlKnob(Decimals=0, Limit=False, Maximum=10, Minimum=0, Range=360, Value=126)
knob_2 = ControlKnob(Decimals=0, Limit=False, Maximum=10, Minimum=0, Range=360, Value=28)

pt = Point([Point(-746.9629505, 948.5099743, 0), Point(-981.9263931, 536.3609849, 0), Point(-338.6658209, 251.3233661, 0), Point(-138.3691158, 879.1764994, 0)])

pline = PolyLine(Vertices=pt, Closed=True)
relay = Relay([knob, knob_2])
lng = ListLength(List=relay)
srf = Surface(pline)
pt_2 = PointCylindrical(BasePlane=PlaneXY(0, 0, 0), Angle=relay, Radius=1, Elevation=0)
popgeo = PopulateGeometry(Geometry=srf, Count=lng, Seed=Slider(3, range=0..10))
extr = Extrude(Base=pline, Direction="0,0,1")
line = LineSDL(Start=popgeo, Direction=pt_2, Length=1)
c_script = CSharpScript(frame=extr, ray=line, count=Slider(10, range=0..10))  # -> shoots; inputs frame: list of Brep, ray: Line, count: Int32
# ---------- c_script: C# usings ----------
using Rhino.Geometry.Intersect;
# ---------- c_script: C# ----------
    shoots = new Polyline
      (
     Intersection.RayShoot(new Ray3d(ray.From,ray.Direction),frame,count)
      );
# ---------- end c_script ----------
rec = Rectangle({Plane=PlaneXY(1015.673249, 494.4663852, 0), Size=Domain2(u=-408.2971297..408.2971297, v=-408.2971297..408.2971297)})
map_srf = MapToSurface(Curve=c_script, Source=pline, Target=rec)
explode = Explode(Curve=map_srf, Recursive=True)  # -> flatten(Segments), Vertices
srfsplit = SurfaceSplit(Surface=rec, Curves=explode.Segments)
join = BrepJoin(Breps=srfsplit)  # -> Breps, Closed
smesh = SimpleMesh(Brep=join.Breps)
checkerboard = Checkerboard(Mesh=smesh)
cull = CullPattern(List=srfsplit, CullPattern=checkerboard)
