# Grasshopper definition Serpentine2.gh (Grasshopper 1.0.7)

knob = ControlKnob(Decimals=0, Limit=False, Maximum=10, Minimum=0, Range=360, Value=126)
knob_2 = ControlKnob(Decimals=0, Limit=False, Maximum=10, Minimum=0, Range=360, Value=28)

pt = Point([Point(-746.9629505, 948.5099743, 0), Point(-981.9263931, 536.3609849, 0), Point(-338.6658209, 251.3233661, 0), Point(-138.3691158, 879.1764994, 0)])

pline = PolyLine(Vertices=pt, Closed=True)
relay = Relay([knob, knob_2])
lng = ListLength(List=relay)
srf = Surface(pline)
pt_2 = PointCylindrical(BasePlane=PlaneXY(0, 0, 0), Angle=relay, Radius=1, Elevation=0)
popgeo = PopulateGeometry(Geometry=srf, Count=lng, Seed=Slider(3, range=0..10))
extr = Extrude(Base=pline, Direction="0,0,1")
line = LineSDL(Start=popgeo, Direction=pt_2, Length=1)
c_script = CSharpScript(frame=extr, ray=line, count=Slider(10, range=0..10))  # -> shoots; inputs frame: list of Brep, ray: Line, count: Int32
# ---------- c_script: C# usings ----------
using Rhino.Geometry.Intersect;
# ---------- c_script: C# ----------
    shoots = new Polyline
      (
     Intersection.RayShoot(new Ray3d(ray.From,ray.Direction),frame,count)
      );
# ---------- end c_script ----------
rec = Rectangle({Plane=PlaneXY(1015.673249, 494.4663852, 0), Size=Domain2(u=-408.2971297..408.2971297, v=-408.2971297..408.2971297)})
map_srf = MapToSurface(Curve=c_script, Source=pline, Target=rec)
explode = Explode(Curve=map_srf, Recursive=True)  # -> flatten(Segments), Vertices
srfsplit = SurfaceSplit(Surface=rec, Curves=explode.Segments)

graft = GraftTree(Tree=explode.Segments, IncludeEmptyLists=True, IncludeNullItems=True)
end = EndPoints(Curve=graft)  # -> Start, End
relay_2 = Relay([end.End, end.Start])
incurve = PointInCurve(Point=relay_2, Curve=rec)  # -> Relationship, Point
crossref = CrossReference(ListA=graft, ListB=relay_2, CrossMode=1)  # -> ListA, ListB
explode_2 = Explode(Curve=rec, Recursive=True)  # -> Segments, Vertices
int = Integer("1")
equals = Equality(FirstNumber=incurve.Relationship, SecondNumber=int)  # -> Equality, Inequality
eval = EvaluateLength(Curve=explode_2.Segments, Length="0.5", Normalized=True)  # -> Point, Tangent, Parameter
cull = CullPattern(List=crossref.ListA, CullPattern=equals.Equality)
cull_2 = CullPattern(List=relay_2, CullPattern=equals.Equality)
vrot = Rotate(Vector=eval.Tangent, Axis="0,0,1", Angle="-pi/2")
crv_cp = CurveClosestPoint(Point=cull_2, Curve=rec)  # -> Point, Parameter, Distance
panel = Panel("""0
1
2
3
4""")
consec = ConsecutiveDomains(Numbers=panel, Additive=False)
amp = Amplitude(Vector=vrot, Amplitude=Slider(287, range=0..1000))
fdom = FindDomain(Domains=consec, Number=crv_cp.Parameter, Strict=False)  # -> flatten(Index), Neighbour
extr_2 = Extrude(Base=explode_2.Segments, Direction=amp)
cset = CreateSet(List=fdom.Index)  # -> Set, Map
item = ListItem(List=explode_2.Segments, Index=cset.Set, Wrap=True)  # -> graft(Item)
item_2 = ListItem(List=extr_2, Index=cset.Set, Wrap=True)  # -> graft(Item)
mindex = MemberIndex(Set=fdom.Index, Member=cset.Set)  # -> Index, Count
item_3 = ListItem(List=flatten(cull), Index=mindex.Index, Wrap=True)
blx = BrepLine(Brep=item_2, Line=item_3, LimitToFirst=False)  # -> Curves, Points
trim = TrimTree(Tree=blx.Curves, Depth=1)
srfsplit_2 = SurfaceSplit(Surface=item_2, Curves=trim)
rotax = RotateAxis(Geometry=srfsplit_2, Angle="0.5*pi", Axis=item)  # -> Geometry, Transform
join = BrepJoin(Breps=flatten([srfsplit, rotax.Geometry]))  # -> Breps, Closed
