# Grasshopper definition gurugurufading.gh (Grasshopper 1.0.7)

panel = Panel("""x
y
y
x""")
panel_2 = Panel("""black
white""")
panel_3 = Panel("""blue
orange""")
entwine = Entwine(Branch00=panel_2, Branch01=panel_3, FlattenInputs=True)
merge = Merge(Data1=Slider(0, range=0..1), Data2=Slider(0, range=0..1), Data3=Slider(0.68, range=0..1), Data4=Slider(1, range=0..1))
panel_4 = Panel("""x
y""")
col = Colour(entwine)
rectangle = Rectangle(Plane=PlaneXY(0, 0, 0), XSize="1", YSize="1", Radius=0)  # -> Rectangle, Length
keysearch = KeyValueSearch(Keys=panel_4, Values=col, Search=panel)
eval = Evaluate(F="if(y=\"x\",{x,0,0},{0,x,0})", x=merge, y=panel)
eval_2 = Evaluate(F="if(y=\"x\",{1,0,0},{0,1,0})", y=panel)
mplane = MeshPlane(Boundary=rectangle.Rectangle, WidthCount="5", HeightCount="5")  # -> Mesh, Area
pl = PlaneNormal(Origin=eval, ZAxis=eval_2)  # -> graft(Plane)
flip = FlipMatrix(Data=keysearch)
demesh = DeconstructMesh(Mesh=mplane.Mesh)  # -> Vertices, Faces, Colours, Normals
srf_cp = SurfaceClosestPoint(Point=demesh.Vertices, Surface=reparameterize(rectangle.Rectangle))  # -> Point, UVPoint, Distance
cp = PlaneClosestPoint(Point=srf_cp.UVPoint, Plane=pl)  # -> Point, UVPoint, Distance
eval_3 = Evaluate(F="(1-abs(y))*(sin(x*pi))^2", y=cp.Distance, x=graft(merge))
neg = Negative(Value=eval)
interp = InterpolateData(Data=flip, Parameter=eval_3, Interpolation=2)
arrlinear = LinearArray(Direction="2,0,0", Count="4")  # -> Geometry, graft(Transform)
mcol = MeshColours(Mesh=mplane.Mesh, Colours=interp)
transform = Transform(Geometry=mcol, Transform=arrlinear.Transform)
move = Move(Geometry=transform, Motion=graft(neg))  # -> Geometry, Transform
