# Grasshopper definition nezuko.gh (Grasshopper 1.0.7)

number_slider = Slider(10, range=0..100)
xy = XYPlane(Origin=Point(0, 0, 0))
number_slider_2 = Slider(10, range=0..10)
rectangle = Rectangle(Plane=PlaneXY(0, 0, 0), XSize=Domain(-1, 1), YSize=Domain(-2, 2), Radius=0)  # -> Rectangle, Length
prot = RotatePlane(Plane=xy, Angle="pi/2")
recgrid = Rectangular(Plane=prot, SizeX=number_slider_2, SizeY=number_slider_2, ExtentX=number_slider, ExtentY=number_slider)  # -> Cells, Points
xz = XZPlane(Origin=Point(0, 0, 0))
tri = Triangulate(Mesh=rectangle.Rectangle)  # -> Mesh, Count
shear = Shear(Base=xz, Grip="0,2", Target="1,SQRT(3)")  # -> Geometry, Transform
recmap = RectangleMapping(Source=rectangle.Rectangle, Target=recgrid.Cells)  # -> Geometry, Transform
facen = FaceNormals(Mesh=tri.Mesh)  # -> graft(Centers), Normals
faceb = FaceBoundaries(Mesh=tri.Mesh)
matrix = Matrix(shear.Transform)
matrix_2 = Matrix(recmap.Transform)
disc = Discontinuity(Curve=faceb, Level=1)  # -> Points, Parameters
multiplication = Multiplication(A=matrix, B=matrix_2)  # -> flatten(Result)
del = DelaunayMesh(Points=[disc.Points, facen.Centers], Plane=PlaneXY(0, 0, 0))
transform = Transform(Geometry=del, Transform=multiplication)
medges = MeshEdges(Mesh=transform)  # -> NakedEdges, InteriorEdges, NonManifoldEdges
mcol = MeshColours(Mesh=transform, Colours="#ECA3AE")
